# Grasshopper definition a-a-a-morph.gh (Grasshopper 1.0.7)
# plug-ins: Human, Pufferfish

number_slider = Slider(3, range=0..10)
addition = Addition(A=number_slider, B=Slider(14, range=0..100))
rectangle = Rectangle(Plane=PlaneXY(0, 0, 0), XSize=Domain(-1, 1), YSize=Domain(-2, 2), Radius=0)  # -> Rectangle, Length
series = Series(Start=0, Step=Slider(8, range=0..100), Count=Slider(4, range=0..1000))
random = Random(Range="1 to 3", Number=Slider(25, range=0..70), Seed=addition)
mesh = Mesh(rectangle.Rectangle)
multiplication = Multiplication(A=random, B=Slider(4, range=0..100))
tri = Triangulate(Mesh=mesh)  # -> Mesh, Count
X = UnitX(Factor=series)
scale_nu = ScaleNU(Geometry=tri.Mesh, Plane=PlaneXY(0, 0, 0), ScaleX=graft(number_slider), ScaleY=graft(multiplication), ScaleZ=1)  # -> Geometry, Transform
move = Move(Geometry=scale_nu.Geometry, Motion=X)  # -> Geometry, Transform
viewer = ParamViewer(move.Geometry)
mjoin = MeshJoin(Meshes=simplify(move.Geometry))
brec = BoundingRectangle(Geometry=mjoin, Plane=PlaneXY(0, 0, 0), Axis=0, Slide=0, Union=True)  # -> Bounding, DimensionX, DimensionY
merge = Merge(Data1=brec.DimensionX, Data2=brec.DimensionY)
area = Area(Geometry=mjoin)  # -> Area, Centroid
sort = SortList(Keys=merge)  # -> Keys, ValuesA
item = ListItem(List=sort.Keys, Index="-1", Wrap=True)
panel = Panel("C:\Users\Matthew\OneDrive\My Documents\home\files\assets\uvs\uv.jpg")
tri_2 = Triangulate(Mesh=mjoin)  # -> Mesh, Count
division = Division(A=item, B=2)
neg = Negative(Value=division)
dom = ConstructDomain(DomainStart=neg, DomainEnd=division)
rectangle_2 = Rectangle(Plane=area.Centroid, XSize=dom, YSize=dom, Radius=0)  # -> Rectangle, Length
boundary = BoundarySurfaces(Edges=rectangle_2.Rectangle)
surfacemap = SurfaceMapping(Mesh=tri_2.Mesh, Surface=boundary)
item_2 = ListItem(List=flatten(surfacemap), Index=Slider(4, range=0..25), Wrap=True)
panel_2 = Panel("basicMorph")
previewmat = CustomPreviewMaterials(Geometry=item_2, DiffuseColor=RGB(255, 255, 255), DiffuseBitmap=panel)
origin = TranslateToOrigin(geo=surfacemap)  # -> G, X
ndims = NormaliseDims(geo=flatten(origin.G))  # -> G, transform_2
scale = Scale(Geometry=ndims.G, Center=Point(0, 0, 0), Factor=Slider(4.2, range=0..10))  # -> Geometry, Transform
demesh = DeconstructMesh(Mesh=scale.Geometry)  # -> Vertices, Faces, Colours, Normals
de_code_mesh = DeCodeMesh(m=scale.Geometry)  # -> F, V, C, N, UVs; inputs m: Mesh
# ---------- de_code_mesh: Python ----------
"""Extract Mesh UV coordinates
    Inputs:
        m: Mesh to extract UV coordinates from
    Output:
        F: List of faces
        V: List of vertices
        C: List of vertex colors, if they exist
        N: List of face normals, if they exist
        UVs: List of texture coordinates (UVs), if they exist"""

__author__ = "Nathan"
__version__ = "2018.07.20"

import rhinoscriptsyntax as rs

if not m==None:
    F = m.Faces
    V = m.Vertices
    N = m.FaceNormals
    C = m.VertexColors
    UVs = m.TextureCoordinates
# ---------- end de_code_mesh ----------
tstat = TreeStatistics(Tree=de_code_mesh.F)  # -> Paths, Length, Count
item_3 = ListItem(List=tstat.Paths, Index=0, Wrap=True)
num = Number("5")
branch = TreeBranch(Tree=de_code_mesh.F, Path=item_3, MaintainPaths=True)
round_point = RoundPoint(data=demesh.Normals, data_2=num)
pdecon = Deconstruct(Point=round_point)  # -> XComponent, YComponent, ZComponent
num_2 = Number("5")
facetoarr = FaceToArr(T=branch)
tstat_2 = TreeStatistics(Tree=de_code_mesh.F)  # -> Paths, Length, Count
round_point_2 = RoundPoint(data=de_code_mesh.V, data_2=num_2)
series_2 = Series(Start=0, Step=1, Count=tstat_2.Count)
pdecon_2 = Deconstruct(Point=round_point_2)  # -> XComponent, YComponent, ZComponent
pdecon_3 = Deconstruct(Point=de_code_mesh.UVs)  # -> XComponent, YComponent, ZComponent
concat = Concatenate(
    FragmentA=pdecon_2.XComponent,
    FragmentB=",",
    FragmentC=pdecon_2.YComponent,
    FragmentD=",",
    FragmentE=pdecon_2.ZComponent,
    FragmentF=",")
concat_2 = Concatenate(FragmentA=pdecon_3.XComponent, FragmentB=",", FragmentC=pdecon_3.YComponent, FragmentD=",")
concat_3 = Concatenate(
    FragmentA=pdecon.XComponent,
    FragmentB=",",
    FragmentC=pdecon.ZComponent,
    FragmentD=",",
    FragmentE=pdecon.YComponent,
    FragmentF=",")
join = TextJoin(Text=facetoarr)
join_2 = TextJoin(Text=concat)
join_3 = TextJoin(Text=concat_2)
join_4 = TextJoin(Text=concat_3)
concat_4 = Concatenate(FragmentA="position", FragmentB="_", FragmentC=series_2, FragmentD=":")  # -> graft(Result)
concat_5 = Concatenate(FragmentA="uv", FragmentB="_", FragmentC=series_2, FragmentD=":")  # -> graft(Result)
concat_6 = Concatenate(FragmentA="normal", FragmentB="_", FragmentC=series_2, FragmentD=":")  # -> graft(Result)
concat_7 = Concatenate(FragmentA="indices:new Uint16Array(", FragmentB="[", FragmentC=join, FragmentD="]),")
concat_8 = Concatenate(FragmentA=concat_4, FragmentB="[", FragmentC=join_2, FragmentD="],")
concat_9 = Concatenate(FragmentA=concat_5, FragmentB="[", FragmentC=join_3, FragmentD="],")
concat_10 = Concatenate(FragmentA=concat_6, FragmentB="[", FragmentC=join_4, FragmentD="],")
concat_11 = Concatenate(FragmentB=concat_8, FragmentC=concat_9, FragmentJ=concat_10)
join_5 = TextJoin(Text=flatten(concat_7))  # -> simplify(Result)
join_6 = TextJoin(Text=flatten(concat_11))  # -> simplify(Result)
concat_12 = Concatenate(FragmentC="export const morphData ={", FragmentA=join_5, FragmentB=join_6, FragmentD="}")
wrtietext = WrtieText(filePath="C:\cWeb\projects\a-a-a\src\data\morph_data.ts", data=concat_12, activate=Toggle(True))  # -> out, A; inputs data: list
# ---------- wrtietext: VB ----------
    If activate Then

      Dim i As Integer
      Dim aryText(4) As String

      aryText(0) = "Mary WriteLine"
      aryText(1) = "Had"
      aryText(2) = "Another"
      aryText(3) = "Little"
      aryText(4) = "One"

      ' the data is appended to the file. If file doesnt exist, a new file is created
      Dim objWriter As New System.IO.StreamWriter(filePath, append)

      For i = 0 To data.Count - 1
        objWriter.WriteLine(data(i))
      Next

      objWriter.Close()

    End If

    If clearFile Then
      Dim objWriter As New System.IO.StreamWriter(filePath, False)
      objWriter.Close()
    End If
# ---------- end wrtietext ----------

# ---- group: to save png double click clock to reset + set rhino viewport to top
clock = Clock(SecondHand=True)

# ----
save = Button()
brec_2 = BoundingRectangle(Geometry=flatten(origin.G), Plane=PlaneXY(0, 0, 0), Axis=0, Slide=0, Union=True)  # -> Bounding, DimensionX, DimensionY
calendar = Calendar()
geo = Geometry(brec_2.Bounding)
cdate = CombineDateTime(Date=calendar, Time=clock)
ddate = DeconstructDate(Date=cdate)  # -> Year, Month, Day, Hour, Minute, Second
concat_13 = Concatenate(
    FragmentA=ddate.Month,
    FragmentB="_",
    FragmentC=ddate.Day,
    FragmentD="_",
    FragmentE=ddate.Hour,
    FragmentG="_",
    FragmentF=ddate.Minute)
python = GhPythonScript(frame=geo, factor=Slider(1, range=0..100), path="C:\cWeb\projects\a-a-a\public\atlas\", filename=concat_13, save=save)  # inputs frame: Polyline, save: Boolean
# ---------- python: Python ----------
import Rhino.Geometry as rg
import Rhino.Display as rd
import scriptcontext as sc
import System, operator

# Get x and y coordinates of frame vertices
px, py = set(frame.X), set(frame.Y)

# Get horizontal and vertical lengths
dx = abs(reduce(operator.sub, px))
dy = abs(reduce(operator.sub, py))

# Construct the points that will set the print area
offx = (dx/dy) * (3/factor)
offy = (dy/dx )* (3/factor)
p1 = rg.Point3d(min(px) + offx, min(py) + offy, 0)
p2 = rg.Point3d(max(px) - offx, max(py) - offy, 0)

# Set resolution to chosen scaling factor
sx, sy = dx*factor, dy*factor


def Capture():

    view = sc.doc.Views.ActiveView
    size = System.Drawing.Size(sx, sy) 

    settings = rd.ViewCaptureSettings(view, size, 300) #view, size, dpi
    settings.SetWindowRect(p1, p2)
    settings.RasterMode = True
    settings.DrawGrid = False
    settings.DrawAxis = False
    settings.DrawWallpaper = False

    bitmap = rd.ViewCapture.CaptureToBitmap(settings)
    bitmap.Save(path+filename+".png")


if save:
    Capture()
# ---------- end python ----------

# ==== cluster RoundPoint
data = ClusterInput()
data_2 = ClusterInput()
data_3 = Data(data)
pdecon = Deconstruct(Point=data_3)  # -> XComponent, YComponent, ZComponent
data_4 = Data(data_2)
roundd = RoundToDecimalPlace(NumberX=pdecon.XComponent, DecimalPlace=data_4, RoundType=0)  # -> Rounded, Difference
roundd_2 = RoundToDecimalPlace(NumberX=pdecon.YComponent, DecimalPlace=data_4, RoundType=0)  # -> Rounded, Difference
roundd_3 = RoundToDecimalPlace(NumberX=pdecon.ZComponent, DecimalPlace=data_4, RoundType=0)  # -> Rounded, Difference
pt = ConstructPoint(XCoordinate=roundd.Rounded, YCoordinate=roundd_2.Rounded, ZCoordinate=roundd_3.Rounded)
pt_2 = ClusterOutput(pt)

# ==== cluster FaceToArr
T = ClusterInput()
rep = ReplaceText(Text=T, Find="T", RecursiveReplace=False)
rep_2 = ReplaceText(Text=rep, Find="{", RecursiveReplace=False)
rep_3 = ReplaceText(Text=rep_2, Find=";", Replace=",", RecursiveReplace=False)
rep_4 = ReplaceText(Text=rep_3, Find="}", Replace=",", RecursiveReplace=False)
R = ClusterOutput(rep_4)

# ==== cluster NormaliseDims
data = ClusterInput()
data_2 = Data(data)
geo = ClusterInput()
geo_2 = Geometry(geo)
bbox = BoundingBox(Content=geo_2, Plane=PlaneXY(0, 0, 0), UnionBox=True)  # -> Box, Box_2
debox = DeconstructBox(Box=bbox.Box)  # -> Plane, X, Y, Z
entwine = Entwine(Branch00=debox.X, Branch01=debox.Y, Branch02=debox.Z, FlattenInputs=True)
dedomain = DeconstructDomain(Domain=entwine)  # -> Start, End
area = Area(Geometry=bbox.Box)  # -> Area, Centroid
sort = SortList(Keys=[dedomain.Start, dedomain.End])  # -> Keys, ValuesA
null = NullItem(Item=data_2)  # -> NullFlags, InvalidFlags, Description
item = ListItem(List=sort.Keys, Index=0, Wrap=True)  # -> Item, Item1
subtraction = Subtraction(A=item.Item1, B=item.Item)  # -> flatten(Result)
sort_2 = SortList(Keys=subtraction)  # -> Keys, ValuesA
item_2 = ListItem(List=sort_2.Keys, Index="-1", Wrap=True)
item_3 = ListItem(List=subtraction, Index=data_2, Wrap=True)
filter = StreamFilter(Gate=null.NullFlags, Stream0=item_3, Stream1=item_2)
division = Division(A="1", B=filter)
scale = Scale(Geometry=geo_2, Center=area.Centroid, Factor=division)  # -> Geometry, Transform
item_4 = ListItem(List=scale.Transform, Index=0, Wrap=True)
G = ClusterOutput(scale.Geometry)
transform = Transform(item_4)
transform_2 = ClusterOutput(transform)

# ==== cluster TranslateToOrigin
geo = ClusterInput()
geo_2 = Geometry(geo)
bbox = BoundingBox(Content=geo_2, Plane=PlaneXY(0, 0, 0), UnionBox=True)  # -> Box, Box_2
area = Area(Geometry=bbox.Box)  # -> Area, Centroid
rev = Reverse(Vector=area.Centroid)
move = Move(Geometry=geo_2, Motion=rev)  # -> Geometry, Transform
G = ClusterOutput(move.Geometry)
X = ClusterOutput(move.Transform)
