# Grasshopper definition a-a-a-morph_atlas.gh (Grasshopper 1.0.7)
# plug-ins: Human, Pufferfish, Moonlight

# ---- group: page
rec = Rectangle({Plane=PlaneXY(-2.572497334, 4.60977938, 0), Size=Domain2(u=-2.334396177..2.334396177, v=-1.319441317..1.319441317)})

# ----
series = Series(Start="1", Step=1, Count=Slider(3, range=0..10))
brec = BoundingRectangle(Geometry=rec, Plane=PlaneXY(0, 0, 0), Axis=0, Slide=0, Union=True)  # -> Bounding, DimensionX, DimensionY
addition = Addition(A=brec.DimensionX, B="1")
multiplication = Multiplication(A=addition, B=series)
rec_2 = Rectangle({Plane=PlaneXY(-3.70474885, 4.56347937, 0), Size=Domain2(u=-1.0085947..1.0085947, v=-1.0085947..1.0085947)})
number_slider = Slider(3, range=0..10)
X = UnitX(Factor=multiplication)
boundary = BoundarySurfaces(Edges=rec_2)  # -> reparameterize(Surfaces)
move = Move(Geometry=rec, Motion=X)  # -> Geometry, Transform
item = ListItem(List=move.Transform, Index="0", Wrap=True)
divide = DivideDomain²(Domain=boundary, UCount=number_slider, VCount=number_slider)
subsrf = Isotrim(Surface=boundary, Domain=divide)
srf = Surface(subsrf)
debrep = DeconstructBrep(Brep=boundary)  # -> Faces, Edges, Vertices
line = Line(Line((6.704638249, 4.49412654, 0), (10.63138744, 4.49412654, 0)))
pt = Point([Point(12.66116256, 3.594003558, 0), Point(12.66116256, 5.395559544, 0), Point(15.22837984, 5.395559544, 0)])
smesh = SimpleMesh(Brep=srf)
item_2 = ListItem(List=debrep.Vertices, Index=Slider(2, range=0..3), Wrap=True)
pline = PolyLine(Vertices=pt, Closed=False)  # -> reparameterize(Polyline)
panel = Panel("C:\cWeb\projects\a-a-a\.system\images\")
tri = Triangulate(Mesh=smesh)  # -> Mesh, Count
scale = Scale(Geometry=boundary, Center=item_2, Factor=Slider(3, range=0..10))  # -> Geometry, Transform
entwine = Entwine(Branch00=line, Branch01=pline, FlattenInputs=True)
lng = ListLength(List=subsrf)
dir = DirectoryContents(FolderPath=panel, Filter="*", IncludeSubfolders=False)  # -> FilePaths, FileNames
series_2 = Series(Start=0, Step=1, Count=lng)
jitter = Jitter(List=dir.FileNames, Jitter=1, Seed=2)  # -> Values, Indices

# ---- group: Multi Map
surfacemap = SurfaceMapping(Mesh=tri.Mesh, Surface=scale.Geometry)

# ---- group: Single Map
surfacemap_2 = SurfaceMapping(Mesh=tri.Mesh, Surface=boundary)

# ---- group: PAGE 2
lng_2 = ListLength(List=tri.Mesh)
range = Range(Domain=Domain(0, 1), Steps=expr("x-1", lng_2))
area = Area(Geometry=surfacemap_2)  # -> Area, Centroid
eval = EvaluateCurve(Curve=entwine, Parameter=range)  # -> Point, Tangent, Angle
vec2pt = Vector2Pt(PointA=area.Centroid, PointB=eval.Point, Unitize=False)  # -> Vector, Length
move_2 = Move(Geometry=surfacemap_2, Motion=vec2pt.Vector)  # -> Geometry, Transform
scale_2 = Scale(Geometry=move_2.Geometry, Center=eval.Point, Factor=Slider(0.4, range=0..1))  # -> Geometry, Transform

# ----
panel_2 = Panel("C:\cWeb\projects\a-a-a\.system\images\AP_0.jpg")
item_3 = ListItem(List=jitter.Values, Index=series_2, Wrap=True)
concat = Concatenate(FragmentA=panel, FragmentB=item_3, FragmentC=".jpg")

# ---- group: PAGE 1
transform = Transform(Geometry=surfacemap, Transform=item)

# ----
range_2 = Range(Domain=Domain(0, 1), Steps=10)
moonlight = Moonlight(Mode=True)
graph = GraphMapper(
    range_2,
    x0=0,
    x1=1,
    y0=0,
    y1=1,
    container_name="Bezier2",
    pt=[Point(0, 0, 0), Point(0, 0.5060433745, 0), Point(0.003306567669, 0.5027368665, 0), Point(0.5405574441, 0.5027368665, 0), Point(1.003306568, 0.5027368665, 0), Point(1, 0.7407898903, 0), Point(1, 1, 0)])
previewmat = CustomPreviewMaterials(Geometry=graft(subsrf), DiffuseColor=RGB(255, 255, 255), DiffuseBitmap=graft(concat))
panel_3 = Panel(graph)
mjoin = MeshJoin(Meshes=scale_2.Geometry)  # -> flatten(Mesh)
previewmat_2 = CustomPreviewMaterials(
    Geometry=graft(mjoin),
    DiffuseColor=RGB(255, 255, 255),
    DiffuseBitmap=graft("C:\cWeb\projects\a-a-a\.system\atlas\atlas.jpg"))
mjoin_2 = MeshJoin(Meshes=transform)  # -> flatten(Mesh)
area_2 = Area(Geometry=move.Geometry)  # -> Area, Centroid
rev = Reverse(Vector=area_2.Centroid)
entwine_2 = Entwine(Branch00=mjoin_2, Branch01=mjoin, FlattenInputs=True)  # -> flatten(Result)
move_3 = Move(Geometry=entwine_2, Motion=rev)  # -> Geometry, Transform
transform_2 = Transform(Geometry=entwine_2, Transform=move_3.Transform)
ndims = NormaliseDims(geo=move_3.Geometry)  # -> G, transform_2
de_code_mesh = DeCodeMesh(m=ndims.G)  # -> F, V, C, N, UVs; inputs m: Mesh
# ---------- de_code_mesh: Python ----------
"""Extract Mesh UV coordinates
    Inputs:
        m: Mesh to extract UV coordinates from
    Output:
        F: List of faces
        V: List of vertices
        C: List of vertex colors, if they exist
        N: List of face normals, if they exist
        UVs: List of texture coordinates (UVs), if they exist"""

__author__ = "Nathan"
__version__ = "2018.07.20"

import rhinoscriptsyntax as rs

if not m==None:
    F = m.Faces
    V = m.Vertices
    N = m.FaceNormals
    C = m.VertexColors
    UVs = m.TextureCoordinates
# ---------- end de_code_mesh ----------
demesh = DeconstructMesh(Mesh=ndims.G)  # -> Vertices, Faces, Colours, Normals
tstat = TreeStatistics(Tree=de_code_mesh.F)  # -> Paths, Length, Count
item_4 = ListItem(List=tstat.Paths, Index=0, Wrap=True)
num = Number("5")
branch = TreeBranch(Tree=de_code_mesh.F, Path=item_4, MaintainPaths=True)
round_point = RoundPoint(data=demesh.Normals, data_2=num)
num_2 = Number("7")
pdecon = Deconstruct(Point=round_point)  # -> XComponent, YComponent, ZComponent
facetoarr = FaceToArr(T=branch)
tstat_2 = TreeStatistics(Tree=de_code_mesh.F)  # -> Paths, Length, Count
round_point_2 = RoundPoint(data=de_code_mesh.V, data_2=num_2)
series_3 = Series(Start=0, Step=1, Count=tstat_2.Count)
pdecon_2 = Deconstruct(Point=round_point_2)  # -> XComponent, YComponent, ZComponent
pdecon_3 = Deconstruct(Point=de_code_mesh.UVs)  # -> XComponent, YComponent, ZComponent
concat_2 = Concatenate(
    FragmentA=pdecon_2.XComponent,
    FragmentB=",",
    FragmentC=pdecon_2.YComponent,
    FragmentD=",",
    FragmentE=pdecon_2.ZComponent,
    FragmentF=",")
concat_3 = Concatenate(FragmentA=pdecon_3.XComponent, FragmentB=",", FragmentC=pdecon_3.YComponent, FragmentD=",")
concat_4 = Concatenate(
    FragmentA=pdecon.XComponent,
    FragmentB=",",
    FragmentC=pdecon.ZComponent,
    FragmentD=",",
    FragmentE=pdecon.YComponent,
    FragmentF=",")
join = TextJoin(Text=facetoarr)
join_2 = TextJoin(Text=concat_2)
join_3 = TextJoin(Text=concat_3)
join_4 = TextJoin(Text=concat_4)
concat_5 = Concatenate(FragmentA="position", FragmentB="_", FragmentC=series_3, FragmentD=":")  # -> graft(Result)
concat_6 = Concatenate(FragmentA="uv", FragmentB="_", FragmentC=series_3, FragmentD=":")  # -> graft(Result)
concat_7 = Concatenate(FragmentA="normal", FragmentB="_", FragmentC=series_3, FragmentD=":")  # -> graft(Result)
brec_2 = BoundingRectangle(Geometry=flatten(boundary), Plane=PlaneXY(0, 0, 0), Axis=0, Slide=0, Union=True)  # -> Bounding, DimensionX, DimensionY
concat_8 = Concatenate(FragmentA="indices:new Uint16Array(", FragmentB="[", FragmentC=join, FragmentD="]),")
concat_9 = Concatenate(FragmentA=concat_5, FragmentB="[", FragmentC=join_2, FragmentD="],")
concat_10 = Concatenate(FragmentA=concat_6, FragmentB="[", FragmentC=join_3, FragmentD="],")
concat_11 = Concatenate(FragmentA=concat_7, FragmentB="[", FragmentC=join_4, FragmentD="],")
panel_4 = Panel("2048")
concat_12 = Concatenate(FragmentB=concat_9, FragmentC=concat_10, FragmentJ=concat_11)
division = Division(A="4096", B=brec_2.DimensionX)
join_5 = TextJoin(Text=flatten(concat_8))  # -> simplify(Result)
join_6 = TextJoin(Text=flatten(concat_12))  # -> simplify(Result)
geo = Geometry(brec_2.Bounding)
concat_13 = Concatenate(FragmentC="export const morphData ={", FragmentA=join_5, FragmentB=join_6, FragmentD="}")
save = Button()
wrtietext = WrtieText(filePath="C:\cWeb\projects\a-a-a\src\data\morph_data.ts", data=concat_13, activate=Toggle(True))  # -> out, A; inputs data: list
# ---------- wrtietext: VB ----------
    If activate Then

      Dim i As Integer
      Dim aryText(4) As String

      aryText(0) = "Mary WriteLine"
      aryText(1) = "Had"
      aryText(2) = "Another"
      aryText(3) = "Little"
      aryText(4) = "One"

      ' the data is appended to the file. If file doesnt exist, a new file is created
      Dim objWriter As New System.IO.StreamWriter(filePath, append)

      For i = 0 To data.Count - 1
        objWriter.WriteLine(data(i))
      Next

      objWriter.Close()

    End If

    If clearFile Then
      Dim objWriter As New System.IO.StreamWriter(filePath, False)
      objWriter.Close()
    End If
# ---------- end wrtietext ----------

# ---- group: to save png double click clock to reset + set rhino viewport to top
clock = Clock(SecondHand=True)

# ----
moonlight_2 = Moonlight(Mode=Toggle(True))
python = GhPythonScript(frame=geo, factor=division, path="C:\cWeb\projects\a-a-a\.system\atlas\", filename="atlas", save=save)  # -> out; inputs frame: Polyline, save: Boolean
# ---------- python: Python ----------
import Rhino.Geometry as rg
import Rhino.Display as rd
import scriptcontext as sc
import System, operator

# Get x and y coordinates of frame vertices
px, py = set(frame.X), set(frame.Y)

# Get horizontal and vertical lengths
dx = abs(reduce(operator.sub, px))
dy = abs(reduce(operator.sub, py))

# Construct the points that will set the print area
offx = (dx/dy) * (3/factor)
offy = (dy/dx )* (3/factor)
p1 = rg.Point3d(min(px) + offx, min(py) + offy, 0)
p2 = rg.Point3d(max(px) - offx, max(py) - offy, 0)

# Set resolution to chosen scaling factor
sx, sy = dx*factor, dy*factor


def Capture():

    view = sc.doc.Views.ActiveView
    size = System.Drawing.Size(sx, sy) 

    settings = rd.ViewCaptureSettings(view, size, 300) #view, size, dpi
    settings.SetWindowRect(p1, p2)
    settings.RasterMode = True
    settings.DrawGrid = False
    settings.DrawAxis = False
    settings.DrawWallpaper = False

    bitmap = rd.ViewCapture.CaptureToBitmap(settings)
    bitmap.Save(path+filename+".jpg")


if save:
    Capture()
# ---------- end python ----------
output_path = Panel(python)
calendar = Calendar()
cdate = CombineDateTime(Date=calendar, Time=clock)
ddate = DeconstructDate(Date=cdate)  # -> Year, Month, Day, Hour, Minute, Second
concat_14 = Concatenate(
    FragmentA=ddate.Month,
    FragmentB="_",
    FragmentC=ddate.Day,
    FragmentD="_",
    FragmentE=ddate.Hour,
    FragmentG="_",
    FragmentF=ddate.Minute)

# ==== cluster RoundPoint
data = ClusterInput()
data_2 = ClusterInput()
data_3 = Data(data)
pdecon = Deconstruct(Point=data_3)  # -> XComponent, YComponent, ZComponent
data_4 = Data(data_2)
roundd = RoundToDecimalPlace(NumberX=pdecon.XComponent, DecimalPlace=data_4, RoundType=0)  # -> Rounded, Difference
roundd_2 = RoundToDecimalPlace(NumberX=pdecon.YComponent, DecimalPlace=data_4, RoundType=0)  # -> Rounded, Difference
roundd_3 = RoundToDecimalPlace(NumberX=pdecon.ZComponent, DecimalPlace=data_4, RoundType=0)  # -> Rounded, Difference
pt = ConstructPoint(XCoordinate=roundd.Rounded, YCoordinate=roundd_2.Rounded, ZCoordinate=roundd_3.Rounded)
pt_2 = ClusterOutput(pt)

# ==== cluster FaceToArr
T = ClusterInput()
rep = ReplaceText(Text=T, Find="T", RecursiveReplace=False)
rep_2 = ReplaceText(Text=rep, Find="{", RecursiveReplace=False)
rep_3 = ReplaceText(Text=rep_2, Find=";", Replace=",", RecursiveReplace=False)
rep_4 = ReplaceText(Text=rep_3, Find="}", Replace=",", RecursiveReplace=False)
R = ClusterOutput(rep_4)

# ==== cluster NormaliseDims
data = ClusterInput()
data_2 = Data(data)
geo = ClusterInput()
geo_2 = Geometry(geo)
bbox = BoundingBox(Content=geo_2, Plane=PlaneXY(0, 0, 0), UnionBox=True)  # -> Box, Box_2
debox = DeconstructBox(Box=bbox.Box)  # -> Plane, X, Y, Z
entwine = Entwine(Branch00=debox.X, Branch01=debox.Y, Branch02=debox.Z, FlattenInputs=True)
dedomain = DeconstructDomain(Domain=entwine)  # -> Start, End
area = Area(Geometry=bbox.Box)  # -> Area, Centroid
sort = SortList(Keys=[dedomain.Start, dedomain.End])  # -> Keys, ValuesA
null = NullItem(Item=data_2)  # -> NullFlags, InvalidFlags, Description
item = ListItem(List=sort.Keys, Index=0, Wrap=True)  # -> Item, Item1
subtraction = Subtraction(A=item.Item1, B=item.Item)  # -> flatten(Result)
sort_2 = SortList(Keys=subtraction)  # -> Keys, ValuesA
item_2 = ListItem(List=sort_2.Keys, Index="-1", Wrap=True)
item_3 = ListItem(List=subtraction, Index=data_2, Wrap=True)
filter = StreamFilter(Gate=null.NullFlags, Stream0=item_3, Stream1=item_2)
division = Division(A="1", B=filter)
scale = Scale(Geometry=geo_2, Center=area.Centroid, Factor=division)  # -> Geometry, Transform
item_4 = ListItem(List=scale.Transform, Index=0, Wrap=True)
G = ClusterOutput(scale.Geometry)
transform = Transform(item_4)
transform_2 = ClusterOutput(transform)
